% Simulink data dictionary data.sldd

servoPins = struct(
  aileron=struct(left=9, right=10),
  elevator=struct(left=7, right=8),
  rudder=11,
  flap=struct(left=5, right=6))

envConsts = struct(magVar=-1.3, refHeight=0)

Uplink = Simulink.Bus()
  AutoflightRefValues: Bus: AutoflightDemandedValues
  Override: boolean
  ControlOverride: Bus: ControlOverrides

Demands = Simulink.Bus()
  FlightMode: Bus: FlightMode
  Altitude: single, Unit="m"
  Heading: single, Unit="deg"
  Override: boolean
  ControlOverrides: Bus: ControlOverrides

AutoflightDemandedValues = Simulink.Bus()
  FlightMode: Bus: FlightMode
  HoldAltitude: single, Unit="m"
  HoldHeading: single, Unit="deg"

ControlOverrides = Simulink.Bus()
  Aileron: single
  Elevator: single
  Flap: single
  Throttle: single
  Rudder: single

Commands = Simulink.Bus()
  Aileron: single, Unit="deg"
  Elevator: single, Unit="deg"
  Flap: single, Unit="deg"
  Throttle: single
  Rudder: single, Unit="deg"

actuatorCentres = struct(
  aileron=struct(left=single(0), right=single(0)),
  elevator=struct(right=single(0), left=single(0)),
  flap=struct(left=single(0), right=single(0)),
  rudder=single(0))

deflectionLimits = struct(
  aileron=struct(min=single(-10), max=single(10)),
  elevator=struct(max=single(10), min=single(-10)),
  flap=struct(max=single(15), min=single(0)),
  rudder=struct(min=single(-5), max=single(5)))

sensorSampleTime = Simulink.Parameter(0.02)
loggingSampleTime = Simulink.Parameter(1)
SecArd = 0

Variants = Simulink.VariantConfigurationData(
  VariantConfigurations=[struct(
    Name="No_Secondary_HIL",
    Description="",
    ControlVariables=[struct(Name="SimType", Value="1", Source="data.sldd"), struct(Name="SecArd", Value="0", Source="data.sldd")],
    SubModelConfigurations=[]), struct(
    Name="With_Secondary_HIL",
    Description="",
    ControlVariables=[struct(Name="SimType", Value="1", Source="data.sldd"), struct(Name="SecArd", Value="1", Source="data.sldd")],
    SubModelConfigurations=[]), struct(
    Name="MIL",
    Description="",
    ControlVariables=[struct(Name="SimType", Value="0", Source="data.sldd"), struct(Name="SecArd", Value="0", Source="data.sldd")],
    SubModelConfigurations=[])],
  DefaultConfigurationName="MIL")

ActuatorStates = Simulink.Bus()
  Aileron: double, Unit="deg"
  Elevator: double, Unit="deg"
  Rudder: double, Unit="deg"
  Flap: double, Unit="deg"

SimType = 0

Sensors = Simulink.Bus()
  X_e: single[3], Unit="m"
  V_b: single[3], Unit="m/s"
  phi_theta_psi: single[3], Unit="rad"
  pqr: single[3], Unit="rad/s"

sensorSystemMatrix = [1 0 0 0.02 0 0 0.0002 0 0 0 0 0 0 0 0
 0 1 0 0 0.02 0 0 0.0002 0 0 0 0 0 0 0
 0 0 1 0 0 0.02 0 0 0.0002 0 0 0 0 0 0
 0 0 0 1 0 0 0.02 0 0 0 0 0 0 0 0
 0 0 0 0 1 0 0 0.02 0 0 0 0 0 0 0
 0 0 0 0 0 1 0 0 0.02 0 0 0 0 0 0
 0 0 0 0 0 0 1 0 0 0 0 0 0 0 0
 0 0 0 0 0 0 0 1 0 0 0 0 0 0 0
 0 0 0 0 0 0 0 0 1 0 0 0 0 0 0
 0 0 0 0 0 0 0 0 0 1 0 0 0.02 0 0
 0 0 0 0 0 0 0 0 0 0 1 0 0 0.02 0
 0 0 0 0 0 0 0 0 0 0 0 1 0 0 0.02
 0 0 0 0 0 0 0 0 0 0 0 0 1 0 0
 0 0 0 0 0 0 0 0 0 0 0 0 0 1 0
 0 0 0 0 0 0 0 0 0 0 0 0 0 0 1]

sensorControlMatrix = [0 0 0
 0 0 0
 0 0 0
 0 0 0
 0 0 0
 0 0 0
 1 0 0
 0 1 0
 0 0 1
 0 0 0
 0 0 0
 0 0 0
 0 0 0
 0 0 0
 0 0 0]

initConditions = struct(x0=[0 0 50], v0=[40 0 0], euler0=[0 0 0], w0=[0 0 0])

vehicle = struct(
  mass=1.5,
  inertia=[0.0521 0 0; 0 0.1175 0; 0 0 0.164],
  wingspan=1.8,
  wingarea=0.1654,
  aclength=1.257,
  CG=[0.4 0 0],
  CP=[0.01 0 -0.001],
  stallSpeed=7.5,
  thrust=7.5619,
  cbar=0.1862)

FlightMode = Simulink.Bus()
  AltHold: single
  HdgHold: single

States = Simulink.Bus()
  phi_theta_psi: double[3], Unit="rad"
  pqr: double[3], Unit="rad/s"
  omega_dot: double[3], Unit="rad/s^2"
  X_e: double[3], Unit="m"
  V_b: double[3], Unit="m/s"
  A_be: double[3], Unit="m/s^2"

datcom1 = {struct(
  case="FLAPS: UAV",
  mach=0.04,
  alt=100,
  alpha=[-10 -8 -6 -4 -2 0 2 4 8 9 10 12 14 16 18 19 20 21 22 24],
  nmach=1,
  nalt=1,
  nalpha=20,
  rnnub=[],
  hypers=false,
  loop=1,
  sref=3.588,
  cbar=0.6109,
  blref=5.91,
  dim="ft",
  deriv="deg",
  stmach=0.6,
  tsmach=1.4,
  save=false,
  stype=[],
  trim=false,
  damp=true,
  build=1,
  part=true,
  highsym=true,
  highasy=false,
  highcon=false,
  tjet=false,
  hypeff=false,
  lb=false,
  pwr=false,
  grnd=false,
  wsspn=2.6575,
  hsspn=1,
  ndelta=5,
  delta=[0 5 10 15 20],
  deltal=[],
  deltar=[],
  ngh=0,
  grndht=[],
  config=struct(downwash=false, body=true, wing=true, htail=false, vtail=false, vfin=false),
  version=1976,
  cd=[0.035; 0.026; 0.02; 0.018; 0.02; 0.024; 0.033; 0.046; 0.085; 0.098; 0.11; 0.131; 0.149; 0.162; 0.157; 0.144; 0.1; 0.05; 0.023; 0.024],
  cl=[-0.582; -0.389; -0.202; -0.023; 0.155; 0.343; 0.538; 0.74; 1.156; 1.261; 1.35; 1.499; 1.617; 1.696; 1.665; 1.586; 1.277; 0.802; 0.295; -0.335],
  cm=[-0.2373; -0.1834; -0.1326; -0.0851; -0.0392; 0.0075; 0.0549; 0.1026; 0.1981; 0.2218; 0.2415; 0.2746; 0.3002; 0.3172; NaN; NaN; NaN; NaN; NaN; NaN],
  cn=[-0.579; -0.389; -0.203; -0.024; 0.154; 0.343; 0.539; 0.741; 1.157; 1.261; 1.348; 1.494; 1.605; 1.675; 1.633; 1.546; 1.234; 0.767; 0.282; -0.297],
  ca=[-0.066; -0.028; -0.001; 0.017; 0.025; 0.024; 0.014; -0.006; -0.076; -0.101; -0.126; -0.184; -0.246; -0.311; -0.365; -0.38; -0.343; -0.24; -0.089; 0.158],
  xcp=[0.41; 0.472; 0.653; 3.567; -0.254; 0.022; 0.102; 0.138; 0.171; 0.176; 0.179; 0.184; 0.187; 0.189; NaN; NaN; NaN; NaN; NaN; NaN],
  cma=[0.02772; 0.02618; 0.02459; 0.02334; 0.02314; 0.02353; 0.02379; 0.02388; 0.02371; 0.02168; 0.01864; 0.01468; 0.01065; 0.006331; NaN; NaN; NaN; NaN; NaN; NaN],
  cyb=repmat(0, 20, 1),
  cnb=repmat(0.003032, 20, 1),
  clb=[-0.0003406; -0.0004155; -0.0004881; -0.0005577; -0.0006268; -0.0006996; -0.0007756; -0.000854; -0.001016; -0.001057; -0.001091; -0.001149; -0.001195; -0.001225; -0.001214; -0.001183; -0.001063; -0.000878; -0.000681; -0.0004363],
  cla=[0.09785; 0.09491; 0.09154; 0.08928; 0.0913; 0.09572; 0.09937; 0.102; 0.105; 0.09668; 0.08372; 0.06683; 0.04913; 0.01213; -0.05832; -0.1942; -0.3919; -0.4912; -0.443; -0.1871],
  clq=repmat(0.005631, 20, 1),
  cmq=repmat(-0.005374, 20, 1),
  clad=[NaN; 99999; 99999; 99999; 99999; 99999; 99999; 99999; 99999; 99999; 99999; 99999; 99999; 99999; 99999; 99999; 99999; 99999; 99999; 99999],
  cmad=[NaN; 99999; 99999; 99999; 99999; 99999; 99999; 99999; 99999; 99999; 99999; 99999; 99999; 99999; 99999; 99999; 99999; 99999; 99999; 99999],
  clp=[-0.0001239; -0.0001119; -0.0001035; -9.968e-5; -0.0001025; -0.0001108; -0.0001226; -0.000138; -0.0001815; -0.0001883; -0.0001903; -0.0001994; -0.0002048; -0.0001898; -0.0001299; -1.125e-5; 0.0001879; 0.0003162; 0.0003078; 0.0001084],
  cyp=[0.0006304; 0.0004246; 0.0002244; 2.572e-5; -0.0001818; -0.0004179; -0.0006948; -0.001037; -0.002255; -0.003282; -0.04057; -0.0003046; -0.001212; -0.001828; -0.002246; -0.002516; -0.00223; -0.001434; -0.0005254; 0.0005564],
  cnp=[0.0009457; 0.0006367; 0.0003366; 3.857e-5; -0.0002726; -0.0006263; -0.00104; -0.001552; -0.003363; -0.004884; -0.06; -0.0004906; -0.001836; -0.002754; -0.003381; -0.00379; -0.003365; -0.002166; -0.0007943; 0.000839],
  cnr=[-0.0001746; -0.0001176; -8.401e-5; -7.175e-5; -7.893e-5; -0.0001073; -0.0001597; -0.0002383; -0.0004786; -0.000556; -0.0006261; -0.000756; -0.0008675; -0.0009471; -0.000916; -0.000837; -0.0005681; -0.0002673; -9.805e-5; -0.0001058],
  clr=[-0.002217; -0.001482; -0.0007698; -8.625e-5; 0.0005917; 0.001306; 0.002051; 0.002821; 0.004408; 0.004809; 0.005145; 0.005716; 0.006164; 0.006465; 0.006349; 0.006045; 0.004869; 0.003056; 0.001124; -0.001278],
  wetarea_b=1.921,
  xcg_b=1.22,
  zcg_b=0.11,
  basearea_b=0.033,
  cd0_b=0.003081,
  basedrag_b=0.0005038,
  fricdrag_b=0.002577,
  presdrag_b=NaN,
  lemac=0.3,
  area_w_tt=3.622,
  taperratio_w_tt=0.619,
  aspectratio_w_tt=9.94,
  qcsweep_w_tt=4.824,
  mac_w_tt=0.616,
  qcmac_w_tt=1.08,
  ymac_w_tt=1.38,
  cd0_w_tt=99999,
  friccoeff_w_tt=99999,
  area_w_te=3.15,
  taperratio_w_te=0.619,
  aspectratio_w_te=8.967,
  qcsweep_w_te=4.824,
  mac_w_te=0.606,
  qcmac_w_te=1.12,
  ymac_w_te=1.56,
  cd0_w_te=0.0136,
  friccoeff_w_te=0.00621,
  cla_b_w=0.01068,
  cla_w_b=0.07637,
  k_b_w=0.1527,
  k_w_b=1.091,
  xacc_b_w=0.3414,
  hiv_b_w=repmat(99999, 20, 1),
  hiv_w_h=repmat(99999, 20, 1),
  hiv_b_h=repmat(99999, 20, 1),
  gamma=[NaN; NaN; NaN; 0; 0; 0; 0; 0; NaN; NaN; NaN; NaN; NaN; NaN; NaN; NaN; NaN; NaN; NaN; NaN],
  gamma2pialpvr=repmat(NaN, 20, 1),
  iv_b_w=repmat(0, 20, 1),
  iv_w_h=repmat(NaN, 20, 1),
  iv_b_h=repmat(NaN, 20, 1),
  clpgammacl0=-0.48484,
  clpgammaclp=1,
  cnptheta=0.00042408,
  cypgamma=0,
  cypcl=-0.080076,
  clbgamma=-0.0002641,
  cmothetaw=NaN,
  cmothetah=NaN,
  dcl_sym=[0; 0.171; 0.341; 0.481; 0.505],
  dcm_sym=[0.0001; 0.0271; 0.0542; 0.0754; 0.0555],
  dclmax_sym=[0; 0.107; 0.207; 0.289; 0.358],
  dcdmin_sym=[1.0e-5; 0.00773; 0.0172; 0.03162; 0.04603],
  clad_sym=repmat(NaN, 5, 1),
  cha_sym=[-0.01045; 99999; 99999; 99999; 99999],
  chd_sym=[-0.01689; -0.01689; -0.01689; -0.017; -0.01736],
  dcdi_sym=[-1.49e-5 -0.00576 -0.00812 -0.00752 -0.00719
   -1.01e-5 -0.00338 -0.00335 -0.000799 -0.000146
   -5.38e-6 -0.000992 0.00142 0.00592 0.0069
   -6.12e-7 0.00139 0.00618 0.0126 0.0139
   4.15e-6 0.00377 0.0109 0.0194 0.021
   8.92e-6 0.00616 0.0157 0.0261 0.028
   1.37e-5 0.00854 0.0205 0.0328 0.0351
   1.84e-5 0.0109 0.0252 0.0395 0.0421
   2.8e-5 0.0157 0.0348 0.0529 0.0562
   3.04e-5 0.0169 0.0372 0.0563 0.0597
   3.28e-5 0.0181 0.0395 0.0597 0.0633
   3.75e-5 0.0205 0.0443 0.0664 0.0703
   4.23e-5 0.0228 0.0491 0.0731 0.0773
   4.7e-5 0.0252 0.0538 0.0798 0.0844
   5.18e-5 0.0276 0.0586 0.0865 0.0914
   5.42e-5 0.0288 0.061 0.0899 0.095
   5.66e-5 0.03 0.0634 0.0932 0.0985
   5.9e-5 0.0312 0.0658 0.0966 0.102
   6.14e-5 0.0324 0.0681 0.1 0.106
   6.62e-5 0.0348 0.0729 0.107 0.113]), struct(
  case="AILERONS: UAV",
  mach=0.04,
  alt=100,
  alpha=[-10 -8 -6 -4 -2 0 2 4 8 9 10 12 14 16 18 19 20 21 22 24],
  nmach=1,
  nalt=1,
  nalpha=20,
  rnnub=[],
  hypers=false,
  loop=1,
  sref=3.588,
  cbar=0.6109,
  blref=5.91,
  dim="ft",
  deriv="deg",
  stmach=0.6,
  tsmach=1.4,
  save=false,
  stype=4,
  trim=false,
  damp=true,
  build=1,
  part=true,
  highsym=false,
  highasy=true,
  highcon=false,
  tjet=false,
  hypeff=false,
  lb=false,
  pwr=false,
  grnd=false,
  wsspn=2.6575,
  hsspn=1,
  ndelta=9,
  delta=[],
  deltal=[-32 -20 -10 -5 0 5 10 20 32],
  deltar=[32 20 10 5 0 -5 -10 -20 -32],
  ngh=0,
  grndht=[],
  config=struct(downwash=false, body=true, wing=true, htail=false, vtail=false, vfin=false),
  version=1976,
  cd=[0.035; 0.026; 0.02; 0.018; 0.02; 0.024; 0.033; 0.046; 0.085; 0.098; 0.11; 0.131; 0.149; 0.162; 0.157; 0.144; 0.1; 0.05; 0.023; 0.024],
  cl=[-0.582; -0.389; -0.202; -0.023; 0.155; 0.343; 0.538; 0.74; 1.156; 1.261; 1.35; 1.499; 1.617; 1.696; 1.665; 1.586; 1.277; 0.802; 0.295; -0.335],
  cm=[-0.2373; -0.1834; -0.1326; -0.0851; -0.0392; 0.0075; 0.0549; 0.1026; 0.1981; 0.2218; 0.2415; 0.2746; 0.3002; 0.3172; NaN; NaN; NaN; NaN; NaN; NaN],
  cn=[-0.579; -0.389; -0.203; -0.024; 0.154; 0.343; 0.539; 0.741; 1.157; 1.261; 1.348; 1.494; 1.605; 1.675; 1.633; 1.546; 1.234; 0.767; 0.282; -0.297],
  ca=[-0.066; -0.028; -0.001; 0.017; 0.025; 0.024; 0.014; -0.006; -0.076; -0.101; -0.126; -0.184; -0.246; -0.311; -0.365; -0.38; -0.343; -0.24; -0.089; 0.158],
  xcp=[0.41; 0.472; 0.653; 3.567; -0.254; 0.022; 0.102; 0.138; 0.171; 0.176; 0.179; 0.184; 0.187; 0.189; NaN; NaN; NaN; NaN; NaN; NaN],
  cma=[0.02772; 0.02618; 0.02459; 0.02334; 0.02314; 0.02353; 0.02379; 0.02388; 0.02371; 0.02168; 0.01864; 0.01468; 0.01065; 0.006331; NaN; NaN; NaN; NaN; NaN; NaN],
  cyb=repmat(0, 20, 1),
  cnb=repmat(0.003032, 20, 1),
  clb=[-0.0003406; -0.0004155; -0.0004881; -0.0005577; -0.0006268; -0.0006996; -0.0007756; -0.000854; -0.001016; -0.001057; -0.001091; -0.001149; -0.001195; -0.001225; -0.001214; -0.001183; -0.001063; -0.000878; -0.000681; -0.0004363],
  cla=[0.09785; 0.09491; 0.09154; 0.08928; 0.0913; 0.09572; 0.09937; 0.102; 0.105; 0.09668; 0.08372; 0.06683; 0.04913; 0.01213; -0.05832; -0.1942; -0.3919; -0.4912; -0.443; -0.1871],
  clq=repmat(0.005631, 20, 1),
  cmq=repmat(-0.005374, 20, 1),
  clad=[NaN; 99999; 99999; 99999; 99999; 99999; 99999; 99999; 99999; 99999; 99999; 99999; 99999; 99999; 99999; 99999; 99999; 99999; 99999; 99999],
  cmad=[NaN; 99999; 99999; 99999; 99999; 99999; 99999; 99999; 99999; 99999; 99999; 99999; 99999; 99999; 99999; 99999; 99999; 99999; 99999; 99999],
  clp=[-0.0001239; -0.0001119; -0.0001035; -9.968e-5; -0.0001025; -0.0001108; -0.0001226; -0.000138; -0.0001815; -0.0001883; -0.0001903; -0.0001994; -0.0002048; -0.0001898; -0.0001299; -1.125e-5; 0.0001879; 0.0003162; 0.0003078; 0.0001084],
  cyp=[0.0006304; 0.0004246; 0.0002244; 2.572e-5; -0.0001818; -0.0004179; -0.0006948; -0.001037; -0.002255; -0.003282; -0.04057; -0.0003046; -0.001212; -0.001828; -0.002246; -0.002516; -0.00223; -0.001434; -0.0005254; 0.0005564],
  cnp=[0.0009457; 0.0006367; 0.0003366; 3.857e-5; -0.0002726; -0.0006263; -0.00104; -0.001552; -0.003363; -0.004884; -0.06; -0.0004906; -0.001836; -0.002754; -0.003381; -0.00379; -0.003365; -0.002166; -0.0007943; 0.000839],
  cnr=[-0.0001746; -0.0001176; -8.401e-5; -7.175e-5; -7.893e-5; -0.0001073; -0.0001597; -0.0002383; -0.0004786; -0.000556; -0.0006261; -0.000756; -0.0008675; -0.0009471; -0.000916; -0.000837; -0.0005681; -0.0002673; -9.805e-5; -0.0001058],
  clr=[-0.002217; -0.001482; -0.0007698; -8.625e-5; 0.0005917; 0.001306; 0.002051; 0.002821; 0.004408; 0.004809; 0.005145; 0.005716; 0.006164; 0.006465; 0.006349; 0.006045; 0.004869; 0.003056; 0.001124; -0.001278],
  wetarea_b=1.921,
  xcg_b=1.22,
  zcg_b=0.11,
  basearea_b=0.033,
  cd0_b=0.003081,
  basedrag_b=0.0005038,
  fricdrag_b=0.002577,
  presdrag_b=NaN,
  lemac=0.3,
  area_w_tt=3.622,
  taperratio_w_tt=0.619,
  aspectratio_w_tt=9.94,
  qcsweep_w_tt=4.824,
  mac_w_tt=0.616,
  qcmac_w_tt=1.08,
  ymac_w_tt=1.38,
  cd0_w_tt=99999,
  friccoeff_w_tt=99999,
  area_w_te=3.15,
  taperratio_w_te=0.619,
  aspectratio_w_te=8.967,
  qcsweep_w_te=4.824,
  mac_w_te=0.606,
  qcmac_w_te=1.12,
  ymac_w_te=1.56,
  cd0_w_te=0.0136,
  friccoeff_w_te=0.00621,
  cla_b_w=0.01068,
  cla_w_b=0.07637,
  k_b_w=0.1527,
  k_w_b=1.091,
  xacc_b_w=0.3414,
  hiv_b_w=repmat(99999, 20, 1),
  hiv_w_h=repmat(99999, 20, 1),
  hiv_b_h=repmat(99999, 20, 1),
  gamma=[NaN; NaN; NaN; 0; 0; 0; 0; 0; NaN; NaN; NaN; NaN; NaN; NaN; NaN; NaN; NaN; NaN; NaN; NaN],
  gamma2pialpvr=repmat(NaN, 20, 1),
  iv_b_w=repmat(0, 20, 1),
  iv_w_h=repmat(NaN, 20, 1),
  iv_b_h=repmat(NaN, 20, 1),
  clpgammacl0=-0.48484,
  clpgammaclp=1,
  cnptheta=0.00042408,
  cypgamma=0,
  cypcl=-0.080076,
  clbgamma=-0.0002641,
  cmothetaw=NaN,
  cmothetah=NaN,
  clroll=[-0.077957; -0.064677; -0.043756; -0.021878; 0; 0.021878; 0.043756; 0.064677; 0.077957],
  cn_asy=[-0.005632 -0.004673 -0.003161 -0.001581 0 0.001581 0.003161 0.004673 0.005632
   -0.003765 -0.003124 -0.002113 -0.001057 0 0.001057 0.002113 0.003124 0.003765
   -0.001955 -0.001622 -0.001098 -0.0005488 0 0.0005488 0.001098 0.001622 0.001955
   -0.0002191 -0.0001818 -0.000123 -6.149e-5 0 6.149e-5 0.000123 0.0001818 0.0002191
   0.001503 0.001247 0.0008436 0.0004218 0 -0.0004218 -0.0008436 -0.001247 -0.001503
   0.003318 0.002752 0.001862 0.0009311 0 -0.0009311 -0.001862 -0.002752 -0.003318
   0.005211 0.004323 0.002925 0.001462 0 -0.001462 -0.002925 -0.004323 -0.005211
   0.007167 0.005946 0.004023 0.002011 0 -0.002011 -0.004023 -0.005946 -0.007167
   0.0112 0.00929 0.006285 0.003142 0 -0.003142 -0.006285 -0.00929 -0.0112
   0.01222 0.01014 0.006857 0.003428 0 -0.003428 -0.006857 -0.01014 -0.01222
   0.01307 0.01084 0.007336 0.003668 0 -0.003668 -0.007336 -0.01084 -0.01307
   0.01452 0.01205 0.00815 0.004075 0 -0.004075 -0.00815 -0.01205 -0.01452
   0.01566 0.01299 0.008789 0.004395 0 -0.004395 -0.008789 -0.01299 -0.01566
   0.01642 0.01363 0.009218 0.004609 0 -0.004609 -0.009218 -0.01363 -0.01642
   0.01613 0.01338 0.009053 0.004526 0 -0.004526 -0.009053 -0.01338 -0.01613
   0.01536 0.01274 0.008619 0.004309 0 -0.004309 -0.008619 -0.01274 -0.01536
   0.01237 0.01026 0.006942 0.003471 0 -0.003471 -0.006942 -0.01026 -0.01237
   0.007764 0.006441 0.004358 0.002179 0 -0.002179 -0.004358 -0.006441 -0.007764
   0.002855 0.002368 0.001602 0.0008011 0 -0.0008011 -0.001602 -0.002368 -0.002855
   -0.003247 -0.002694 -0.001822 -0.0009112 0 0.0009112 0.001822 0.002694 0.003247]), struct(
  case="TOTAL: AILERONS: UAV",
  mach=0.04,
  alt=100,
  alpha=[-10 -8 -6 -4 -2 0 2 4 8 9 10 12 14 16 18 19 20 21 22 24],
  nmach=1,
  nalt=1,
  nalpha=20,
  rnnub=[],
  hypers=false,
  loop=1,
  sref=3.588,
  cbar=0.6109,
  blref=5.91,
  dim="ft",
  deriv="deg",
  stmach=0.6,
  tsmach=1.4,
  save=false,
  stype=[],
  trim=false,
  damp=true,
  build=1,
  part=true,
  highsym=true,
  highasy=false,
  highcon=false,
  tjet=false,
  hypeff=false,
  lb=false,
  pwr=false,
  grnd=false,
  wsspn=2.6575,
  hsspn=0.66,
  ndelta=8,
  delta=[-15 -10 -5 0 5 10 13 16],
  deltal=[],
  deltar=[],
  ngh=0,
  grndht=[],
  config=struct(downwash=true, body=true, wing=true, htail=true, vtail=true, vfin=false),
  version=1976,
  cd=[0.051; 0.037; 0.029; 0.024; 0.024; 0.028; 0.036; 0.05; 0.093; 0.107; 0.121; 0.147; 0.17; 0.19; 0.193; 0.184; 0.144; 0.096; 0.067; 0.052],
  cl=[-0.653; -0.449; -0.25; -0.059; 0.132; 0.331; 0.537; 0.75; 1.188; 1.299; 1.393; 1.556; 1.687; 1.782; 1.767; 1.695; 1.393; 0.924; 0.418; -0.247],
  cm=[0.0687; 0.0743; 0.074; 0.0679; 0.0574; 0.0573; 0.0608; 0.0612; 0.0598; 0.0593; 0.0532; 0.0286; -0.0067; -0.0613; NaN; NaN; NaN; NaN; NaN; NaN],
  cn=[-0.652; -0.45; -0.252; -0.06; 0.132; 0.331; 0.538; 0.751; 1.19; 1.3; 1.393; 1.552; 1.678; 1.765; 1.74; 1.662; 1.358; 0.897; 0.412; -0.204],
  ca=[-0.064; -0.026; 0.002; 0.02; 0.028; 0.028; 0.018; -0.002; -0.073; -0.097; -0.123; -0.18; -0.243; -0.308; -0.362; -0.378; -0.342; -0.242; -0.095; 0.148],
  xcp=[-0.105; -0.165; -0.294; -1.129; 0.436; 0.173; 0.113; 0.081; 0.05; 0.046; 0.038; 0.018; -0.004; -0.035; NaN; NaN; NaN; NaN; NaN; NaN],
  cma=[0.003056; 0.001336; -0.0016; -0.004161; -0.002657; 0.0008498; 0.0009853; 2.578e-5; -0.0004981; -0.003293; -0.008134; -0.01498; -0.02249; -0.03213; NaN; NaN; NaN; NaN; NaN; NaN],
  cyb=repmat(-0.00246, 20, 1),
  cnb=repmat(0.003032, 20, 1),
  clb=[-0.0005913; -0.0006471; -0.0007001; -0.0007494; -0.0007975; -0.0008486; -0.0009026; -0.0009595; -0.001079; -0.00111; -0.001134; -0.00117; -0.00119; -0.001194; -0.001152; -0.001105; -0.0009692; -0.000765; -0.000543; -0.0002515],
  cla=[0.1043; 0.1006; 0.09761; 0.0957; 0.09736; 0.1011; 0.1047; 0.1076; 0.1106; 0.1024; 0.08977; 0.0735; 0.05645; 0.01999; -0.05064; -0.1869; -0.3856; -0.4879; -0.4481; -0.2161],
  qqinf=[1; 1; 1; 0.999; 0.948; 0.932; 0.988; 1; 1; 1; 1; 1; 1; 1; 1; 1; 1; 1; 1; 1],
  eps=[-2.278; -1.544; -0.813; -0.094; 0.636; 1.4; 2.162; 2.928; 4.452; 4.816; 5.163; 5.674; 6.09; 6.296; 6.225; 5.888; 5.294; 3.966; 2.631; 0.977],
  depsdalp=[0.367; 0.366; 0.363; 0.362; 0.373; 0.381; 0.382; 0.382; 0.367; 0.356; 0.316; 0.232; 0.156; 0.034; -0.237; -0.466; -0.961; -1.332; -1.166; -0.827],
  clq=repmat(0.09228, 20, 1),
  cmq=repmat(-0.3711, 20, 1),
  clad=[0.03181; 0.03173; 0.03141; 0.03137; 0.03067; 0.0308; 0.03271; 0.03313; 0.03183; 0.0308; 0.02742; 0.02007; 0.01348; 0.002941; -0.0205; -0.04034; -0.08327; -0.1154; -0.101; -0.07164],
  cmad=[-0.1342; -0.1339; -0.1326; -0.1324; -0.1295; -0.13; -0.138; -0.1398; -0.1343; -0.13; -0.1157; -0.08469; -0.05688; -0.01241; 0.08651; 0.1702; 0.3515; 0.487; 0.4263; 0.3023],
  clp=[-0.0001863; -0.0001621; -0.0001431; -0.0001302; -0.0001255; -0.0001284; -0.0001375; -0.0001524; -0.0002; -0.0002089; -0.0002127; -0.0002245; -0.000234; -0.0002248; -0.0001726; -5.986e-5; 0.0001379; 0.0002734; 0.0002643; 4.186e-5],
  cyp=[0.0003016; 0.0001603; 2.54e-5; -0.0001075; -0.0002486; -0.0004179; -0.0006276; -0.0009026; -0.001985; -0.002978; -0.04023; 0.000101; -0.0007384; -0.001287; -0.001638; -0.001875; -0.001556; -0.0007261; 0.0002154; 0.001363],
  cnp=[0.001069; 0.0007366; 0.0004126; 8.984e-5; -0.0002467; -0.0006263; -0.001067; -0.001605; -0.003469; -0.005004; -0.06013; -0.0006505; -0.002022; -0.002966; -0.003618; -0.004039; -0.003626; -0.002439; -0.001079; 0.0005317],
  cnr=[-0.0008617; -0.0008204; -0.0008008; -0.000801; -0.0008189; -0.0008563; -0.0009159; -0.0009999; -0.001245; -0.001323; -0.001393; -0.001521; -0.001628; -0.001702; -0.001663; -0.00158; -0.001306; -0.001; -0.0008252; -0.0008202],
  clr=[-0.001983; -0.00127; -0.0005801; 7.971e-5; 0.0007331; 0.001422; 0.002142; 0.002886; 0.004419; 0.004807; 0.005129; 0.005674; 0.006095; 0.00637; 0.006228; 0.005911; 0.004723; 0.002898; 0.0009534; -0.001472],
  wetarea_b=1.921,
  xcg_b=1.22,
  zcg_b=0.11,
  basearea_b=0.033,
  cd0_b=0.003081,
  basedrag_b=0.0005038,
  fricdrag_b=0.002577,
  presdrag_b=NaN,
  lemac=0.3,
  area_w_tt=3.622,
  taperratio_w_tt=0.619,
  aspectratio_w_tt=9.94,
  qcsweep_w_tt=4.824,
  mac_w_tt=0.616,
  qcmac_w_tt=1.08,
  ymac_w_tt=1.38,
  cd0_w_tt=99999,
  friccoeff_w_tt=99999,
  area_w_te=3.15,
  taperratio_w_te=0.619,
  aspectratio_w_te=8.967,
  qcsweep_w_te=4.824,
  mac_w_te=0.606,
  qcmac_w_te=1.12,
  ymac_w_te=1.56,
  cd0_w_te=0.0136,
  friccoeff_w_te=0.00621,
  area_ht_tt=0.5412,
  taperratio_ht_tt=0.608,
  aspectratio_ht_tt=3.22,
  qcsweep_ht_tt=11,
  mac_ht_tt=0.418,
  qcmac_ht_tt=3.8,
  ymac_ht_tt=0.303,
  cd0_ht_tt=99999,
  friccoeff_ht_tt=99999,
  area_ht_te=0.5412,
  taperratio_ht_te=0.608,
  aspectratio_ht_te=3.22,
  qcsweep_ht_te=11,
  mac_ht_te=0.418,
  qcmac_ht_te=3.8,
  ymac_ht_te=0.303,
  cd0_ht_te=0.0023,
  friccoeff_ht_te=0.00667,
  area_vt_tt=0.3312,
  taperratio_vt_tt=0.394,
  aspectratio_vt_tt=1.565,
  qcsweep_vt_tt=23,
  mac_vt_tt=0.489,
  qcmac_vt_tt=3.53,
  ymac_vt_tt=0.468,
  cd0_vt_tt=99999,
  friccoeff_vt_tt=99999,
  area_vt_te=0.3312,
  taperratio_vt_te=0.394,
  aspectratio_vt_te=1.565,
  qcsweep_vt_te=23,
  mac_vt_te=0.489,
  qcmac_vt_te=3.53,
  ymac_vt_te=0.308,
  cd0_vt_te=0.00136,
  friccoeff_vt_te=0.00647,
  cla_b_w=0.01068,
  cla_w_b=0.07637,
  k_b_w=0.1527,
  k_w_b=1.091,
  xacc_b_w=0.3414,
  cla_b_h=0,
  cla_h_b=0.01027,
  k_b_h=0,
  k_h_b=1,
  xacc_b_h=0.2075,
  sidewash=0.67157567,
  hiv_b_w=repmat(99999, 20, 1),
  hiv_w_h=repmat(99999, 20, 1),
  hiv_b_h=repmat(99999, 20, 1),
  gamma=[NaN; NaN; NaN; 0; 0; 0; 0; 0; NaN; NaN; NaN; NaN; NaN; NaN; NaN; NaN; NaN; NaN; NaN; NaN],
  gamma2pialpvr=[0.637; 0.4918; 0.406; 0; 0; 0; 0; 0; 0.4918; 0.5661; 0.637; 0.7929; 0.9332; 1.084; 1.23; 1.304; 1.383; 1.439; 1.497; 1.619],
  iv_b_w=repmat(0, 20, 1),
  iv_w_h=repmat(NaN, 20, 1),
  iv_b_h=[-0.1774; -0.08325; -0.003164; 0; 0; 0; 0; 0; -0.08325; -0.1385; -0.1774; -0.2285; -0.2498; -0.2595; -0.2676; -0.2689; -0.2696; -0.27; -0.2704; -0.2706],
  clpgammacl0=-0.48484,
  clpgammaclp=1,
  cnptheta=0.00042408,
  cypgamma=0,
  cypcl=-0.080076,
  clbgamma=-0.0002641,
  cmothetaw=NaN,
  cmothetah=NaN,
  dcl_sym=[-0.084; -0.057; -0.028; 0; 0.028; 0.057; 0.073; 0.088],
  dcm_sym=[0.2784; 0.1903; 0.0952; -0.0002; -0.0952; -0.1903; -0.2448; -0.2935],
  dclmax_sym=[0.056; 0.041; 0.021; 0; 0.021; 0.041; 0.05; 0.059],
  dcdmin_sym=[0.00218; 0.00088; 0.00044; 0; 0.00044; 0.00088; 0.00166; 0.00248],
  clad_sym=repmat(NaN, 8, 1),
  cha_sym=[-0.002215; 99999; 99999; 99999; 99999; 99999; 99999; 99999],
  chd_sym=[-0.00626; -0.006213; -0.006213; -0.006213; -0.006213; -0.006213; -0.006231; -0.006284],
  dcdi_sym=[0.00555 0.0032 0.00129 -1.95e-6 -0.000663 -0.000699 -0.000434 -2.41e-5
   0.00465 0.00258 0.000979 -1.33e-6 -0.000352 -7.85e-5 0.000365 0.000935
   0.00373 0.00196 0.000668 -7.08e-7 -4.13e-5 0.000544 0.00117 0.0019
   0.00281 0.00133 0.000354 -8.0e-8 0.000273 0.00117 0.00198 0.00287
   0.0019 0.000711 4.24e-5 5.43e-7 0.000584 0.00179 0.00278 0.00383
   0.00101 0.000105 -0.00026 1.15e-6 0.000887 0.0024 0.00356 0.00477
   0.000121 -0.000502 -0.000564 1.76e-6 0.00119 0.00301 0.00434 0.0057
   -0.000766 -0.00111 -0.000866 2.36e-6 0.00149 0.00361 0.00512 0.00664
   -0.00255 -0.00232 -0.00147 3.57e-6 0.0021 0.00483 0.00669 0.00851
   -0.003 -0.00263 -0.00163 3.89e-6 0.00226 0.00514 0.00709 0.009
   -0.00347 -0.00295 -0.00179 4.21e-6 0.00242 0.00546 0.0075 0.00949
   -0.00454 -0.00368 -0.00215 4.94e-6 0.00278 0.00619 0.00844 0.0106
   -0.00568 -0.00446 -0.00254 5.71e-6 0.00317 0.00696 0.00944 0.0118
   -0.00697 -0.00534 -0.00298 6.59e-6 0.00361 0.00784 0.0106 0.0132
   -0.00846 -0.00635 -0.00349 7.61e-6 0.00412 0.00886 0.0119 0.0147
   -0.00942 -0.00701 -0.00382 8.27e-6 0.00444 0.00951 0.0127 0.0158
   -0.0106 -0.00779 -0.00421 9.05e-6 0.00483 0.0103 0.0137 0.017
   -0.0122 -0.00893 -0.00478 1.02e-5 0.00541 0.0114 0.0152 0.0187
   -0.0139 -0.0101 -0.00535 1.13e-5 0.00598 0.0126 0.0167 0.0205
   -0.0165 -0.0119 -0.00625 1.31e-5 0.00687 0.0144 0.019 0.0233])}

datcomorig = {struct(
  case="FLAPS: UAV",
  mach=0.04,
  alt=100,
  alpha=[-10 -8 -6 -4 -2 0 2 4 8 9 10 12 14 16 18 19 20 21 22 24],
  nmach=1,
  nalt=1,
  nalpha=20,
  rnnub=[],
  hypers=false,
  loop=1,
  sref=3.588,
  cbar=0.6109,
  blref=5.91,
  dim="ft",
  deriv="deg",
  stmach=0.6,
  tsmach=1.4,
  save=false,
  stype=[],
  trim=false,
  damp=true,
  build=1,
  part=true,
  highsym=true,
  highasy=false,
  highcon=false,
  tjet=false,
  hypeff=false,
  lb=false,
  pwr=false,
  grnd=false,
  wsspn=2.6575,
  hsspn=1,
  ndelta=5,
  delta=[0 5 10 15 20],
  deltal=[],
  deltar=[],
  ngh=0,
  grndht=[],
  config=struct(downwash=false, body=true, wing=true, htail=false, vtail=false, vfin=false),
  version=1976,
  cd=[0.035; 0.026; 0.02; 0.018; 0.02; 0.024; 0.033; 0.046; 0.085; 0.098; 0.11; 0.131; 0.149; 0.162; 0.157; 0.144; 0.1; 0.05; 0.023; 0.024],
  cl=[-0.582; -0.389; -0.202; -0.023; 0.155; 0.343; 0.538; 0.74; 1.156; 1.261; 1.35; 1.499; 1.617; 1.696; 1.665; 1.586; 1.277; 0.802; 0.295; -0.335],
  cm=[-0.2373; -0.1834; -0.1326; -0.0851; -0.0392; 0.0075; 0.0549; 0.1026; 0.1981; 0.2218; 0.2415; 0.2746; 0.3002; 0.3172; NaN; NaN; NaN; NaN; NaN; NaN],
  cn=[-0.579; -0.389; -0.203; -0.024; 0.154; 0.343; 0.539; 0.741; 1.157; 1.261; 1.348; 1.494; 1.605; 1.675; 1.633; 1.546; 1.234; 0.767; 0.282; -0.297],
  ca=[-0.066; -0.028; -0.001; 0.017; 0.025; 0.024; 0.014; -0.006; -0.076; -0.101; -0.126; -0.184; -0.246; -0.311; -0.365; -0.38; -0.343; -0.24; -0.089; 0.158],
  xcp=[0.41; 0.472; 0.653; 3.567; -0.254; 0.022; 0.102; 0.138; 0.171; 0.176; 0.179; 0.184; 0.187; 0.189; NaN; NaN; NaN; NaN; NaN; NaN],
  cma=[0.02772; 0.02618; 0.02459; 0.02334; 0.02314; 0.02353; 0.02379; 0.02388; 0.02371; 0.02168; 0.01864; 0.01468; 0.01065; 0.006331; NaN; NaN; NaN; NaN; NaN; NaN],
  cyb=repmat(0, 20, 1),
  cnb=repmat(0.09896, 20, 1),
  clb=[-0.0003406; -0.0004155; -0.0004881; -0.0005577; -0.0006268; -0.0006996; -0.0007756; -0.000854; -0.001016; -0.001057; -0.001091; -0.001149; -0.001195; -0.001225; -0.001214; -0.001183; -0.001063; -0.000878; -0.000681; -0.0004363],
  cla=[0.09785; 0.09491; 0.09154; 0.08928; 0.0913; 0.09572; 0.09937; 0.102; 0.105; 0.09668; 0.08372; 0.06683; 0.04913; 0.01213; -0.05832; -0.1942; -0.3919; -0.4912; -0.443; -0.1871],
  clq=repmat(0.005631, 20, 1),
  cmq=repmat(-0.005374, 20, 1),
  clad=[NaN; 99999; 99999; 99999; 99999; 99999; 99999; 99999; 99999; 99999; 99999; 99999; 99999; 99999; 99999; 99999; 99999; 99999; 99999; 99999],
  cmad=[NaN; 99999; 99999; 99999; 99999; 99999; 99999; 99999; 99999; 99999; 99999; 99999; 99999; 99999; 99999; 99999; 99999; 99999; 99999; 99999],
  clp=[-0.0001239; -0.0001119; -0.0001035; -9.968e-5; -0.0001025; -0.0001108; -0.0001226; -0.000138; -0.0001815; -0.0001883; -0.0001903; -0.0001994; -0.0002048; -0.0001898; -0.0001299; -1.125e-5; 0.0001879; 0.0003162; 0.0003078; 0.0001084],
  cyp=[0.0006304; 0.0004246; 0.0002244; 2.572e-5; -0.0001818; -0.0004179; -0.0006948; -0.001037; -0.002255; -0.003282; -0.04057; -0.0003046; -0.001212; -0.001828; -0.002246; -0.002516; -0.00223; -0.001434; -0.0005254; 0.0005564],
  cnp=[0.0009457; 0.0006367; 0.0003366; 3.857e-5; -0.0002726; -0.0006263; -0.00104; -0.001552; -0.003363; -0.004884; -0.06; -0.0004906; -0.001836; -0.002754; -0.003381; -0.00379; -0.003365; -0.002166; -0.0007943; 0.000839],
  cnr=[-0.0001746; -0.0001176; -8.401e-5; -7.175e-5; -7.893e-5; -0.0001073; -0.0001597; -0.0002383; -0.0004786; -0.000556; -0.0006261; -0.000756; -0.0008675; -0.0009471; -0.000916; -0.000837; -0.0005681; -0.0002673; -9.805e-5; -0.0001058],
  clr=[-0.002217; -0.001482; -0.0007698; -8.625e-5; 0.0005917; 0.001306; 0.002051; 0.002821; 0.004408; 0.004809; 0.005145; 0.005716; 0.006164; 0.006465; 0.006349; 0.006045; 0.004869; 0.003056; 0.001124; -0.001278],
  wetarea_b=1.921,
  xcg_b=1.22,
  zcg_b=0.11,
  basearea_b=0.033,
  cd0_b=0.003081,
  basedrag_b=0.0005038,
  fricdrag_b=0.002577,
  presdrag_b=NaN,
  lemac=0.3,
  area_w_tt=3.622,
  taperratio_w_tt=0.619,
  aspectratio_w_tt=9.94,
  qcsweep_w_tt=4.824,
  mac_w_tt=0.616,
  qcmac_w_tt=1.08,
  ymac_w_tt=1.38,
  cd0_w_tt=99999,
  friccoeff_w_tt=99999,
  area_w_te=3.15,
  taperratio_w_te=0.619,
  aspectratio_w_te=8.967,
  qcsweep_w_te=4.824,
  mac_w_te=0.606,
  qcmac_w_te=1.12,
  ymac_w_te=1.56,
  cd0_w_te=0.0136,
  friccoeff_w_te=0.00621,
  cla_b_w=0.01068,
  cla_w_b=0.07637,
  k_b_w=0.1527,
  k_w_b=1.091,
  xacc_b_w=0.3414,
  hiv_b_w=repmat(99999, 20, 1),
  hiv_w_h=repmat(99999, 20, 1),
  hiv_b_h=repmat(99999, 20, 1),
  gamma=[NaN; NaN; NaN; 0; 0; 0; 0; 0; NaN; NaN; NaN; NaN; NaN; NaN; NaN; NaN; NaN; NaN; NaN; NaN],
  gamma2pialpvr=repmat(NaN, 20, 1),
  iv_b_w=repmat(0, 20, 1),
  iv_w_h=repmat(NaN, 20, 1),
  iv_b_h=repmat(NaN, 20, 1),
  clpgammacl0=-0.48484,
  clpgammaclp=1,
  cnptheta=0.00042408,
  cypgamma=0,
  cypcl=-0.080076,
  clbgamma=-0.0002641,
  cmothetaw=NaN,
  cmothetah=NaN,
  dcl_sym=[0; 0.171; 0.341; 0.481; 0.505],
  dcm_sym=[0.0001; 0.0271; 0.0542; 0.0754; 0.0555],
  dclmax_sym=[0; 0.107; 0.207; 0.289; 0.358],
  dcdmin_sym=[1.0e-5; 0.00773; 0.0172; 0.03162; 0.04603],
  clad_sym=repmat(NaN, 5, 1),
  cha_sym=[-0.01045; 99999; 99999; 99999; 99999],
  chd_sym=[-0.01689; -0.01689; -0.01689; -0.017; -0.01736],
  dcdi_sym=[-1.49e-5 -0.00576 -0.00812 -0.00752 -0.00719
   -1.01e-5 -0.00338 -0.00335 -0.000799 -0.000146
   -5.38e-6 -0.000992 0.00142 0.00592 0.0069
   -6.12e-7 0.00139 0.00618 0.0126 0.0139
   4.15e-6 0.00377 0.0109 0.0194 0.021
   8.92e-6 0.00616 0.0157 0.0261 0.028
   1.37e-5 0.00854 0.0205 0.0328 0.0351
   1.84e-5 0.0109 0.0252 0.0395 0.0421
   2.8e-5 0.0157 0.0348 0.0529 0.0562
   3.04e-5 0.0169 0.0372 0.0563 0.0597
   3.28e-5 0.0181 0.0395 0.0597 0.0633
   3.75e-5 0.0205 0.0443 0.0664 0.0703
   4.23e-5 0.0228 0.0491 0.0731 0.0773
   4.7e-5 0.0252 0.0538 0.0798 0.0844
   5.18e-5 0.0276 0.0586 0.0865 0.0914
   5.42e-5 0.0288 0.061 0.0899 0.095
   5.66e-5 0.03 0.0634 0.0932 0.0985
   5.9e-5 0.0312 0.0658 0.0966 0.102
   6.14e-5 0.0324 0.0681 0.1 0.106
   6.62e-5 0.0348 0.0729 0.107 0.113]), struct(
  case="AILERONS: UAV",
  mach=0.04,
  alt=100,
  alpha=[-10 -8 -6 -4 -2 0 2 4 8 9 10 12 14 16 18 19 20 21 22 24],
  nmach=1,
  nalt=1,
  nalpha=20,
  rnnub=[],
  hypers=false,
  loop=1,
  sref=3.588,
  cbar=0.6109,
  blref=5.91,
  dim="ft",
  deriv="deg",
  stmach=0.6,
  tsmach=1.4,
  save=false,
  stype=4,
  trim=false,
  damp=true,
  build=1,
  part=true,
  highsym=false,
  highasy=true,
  highcon=false,
  tjet=false,
  hypeff=false,
  lb=false,
  pwr=false,
  grnd=false,
  wsspn=2.6575,
  hsspn=1,
  ndelta=9,
  delta=[],
  deltal=[-32 -20 -10 -5 0 5 10 20 32],
  deltar=[32 20 10 5 0 -5 -10 -20 -32],
  ngh=0,
  grndht=[],
  config=struct(downwash=false, body=true, wing=true, htail=false, vtail=false, vfin=false),
  version=1976,
  cd=[0.035; 0.026; 0.02; 0.018; 0.02; 0.024; 0.033; 0.046; 0.085; 0.098; 0.11; 0.131; 0.149; 0.162; 0.157; 0.144; 0.1; 0.05; 0.023; 0.024],
  cl=[-0.582; -0.389; -0.202; -0.023; 0.155; 0.343; 0.538; 0.74; 1.156; 1.261; 1.35; 1.499; 1.617; 1.696; 1.665; 1.586; 1.277; 0.802; 0.295; -0.335],
  cm=[-0.2373; -0.1834; -0.1326; -0.0851; -0.0392; 0.0075; 0.0549; 0.1026; 0.1981; 0.2218; 0.2415; 0.2746; 0.3002; 0.3172; NaN; NaN; NaN; NaN; NaN; NaN],
  cn=[-0.579; -0.389; -0.203; -0.024; 0.154; 0.343; 0.539; 0.741; 1.157; 1.261; 1.348; 1.494; 1.605; 1.675; 1.633; 1.546; 1.234; 0.767; 0.282; -0.297],
  ca=[-0.066; -0.028; -0.001; 0.017; 0.025; 0.024; 0.014; -0.006; -0.076; -0.101; -0.126; -0.184; -0.246; -0.311; -0.365; -0.38; -0.343; -0.24; -0.089; 0.158],
  xcp=[0.41; 0.472; 0.653; 3.567; -0.254; 0.022; 0.102; 0.138; 0.171; 0.176; 0.179; 0.184; 0.187; 0.189; NaN; NaN; NaN; NaN; NaN; NaN],
  cma=[0.02772; 0.02618; 0.02459; 0.02334; 0.02314; 0.02353; 0.02379; 0.02388; 0.02371; 0.02168; 0.01864; 0.01468; 0.01065; 0.006331; NaN; NaN; NaN; NaN; NaN; NaN],
  cyb=repmat(0, 20, 1),
  cnb=repmat(0.09896, 20, 1),
  clb=[-0.0003406; -0.0004155; -0.0004881; -0.0005577; -0.0006268; -0.0006996; -0.0007756; -0.000854; -0.001016; -0.001057; -0.001091; -0.001149; -0.001195; -0.001225; -0.001214; -0.001183; -0.001063; -0.000878; -0.000681; -0.0004363],
  cla=[0.09785; 0.09491; 0.09154; 0.08928; 0.0913; 0.09572; 0.09937; 0.102; 0.105; 0.09668; 0.08372; 0.06683; 0.04913; 0.01213; -0.05832; -0.1942; -0.3919; -0.4912; -0.443; -0.1871],
  clq=repmat(0.005631, 20, 1),
  cmq=repmat(-0.005374, 20, 1),
  clad=[NaN; 99999; 99999; 99999; 99999; 99999; 99999; 99999; 99999; 99999; 99999; 99999; 99999; 99999; 99999; 99999; 99999; 99999; 99999; 99999],
  cmad=[NaN; 99999; 99999; 99999; 99999; 99999; 99999; 99999; 99999; 99999; 99999; 99999; 99999; 99999; 99999; 99999; 99999; 99999; 99999; 99999],
  clp=[-0.0001239; -0.0001119; -0.0001035; -9.968e-5; -0.0001025; -0.0001108; -0.0001226; -0.000138; -0.0001815; -0.0001883; -0.0001903; -0.0001994; -0.0002048; -0.0001898; -0.0001299; -1.125e-5; 0.0001879; 0.0003162; 0.0003078; 0.0001084],
  cyp=[0.0006304; 0.0004246; 0.0002244; 2.572e-5; -0.0001818; -0.0004179; -0.0006948; -0.001037; -0.002255; -0.003282; -0.04057; -0.0003046; -0.001212; -0.001828; -0.002246; -0.002516; -0.00223; -0.001434; -0.0005254; 0.0005564],
  cnp=[0.0009457; 0.0006367; 0.0003366; 3.857e-5; -0.0002726; -0.0006263; -0.00104; -0.001552; -0.003363; -0.004884; -0.06; -0.0004906; -0.001836; -0.002754; -0.003381; -0.00379; -0.003365; -0.002166; -0.0007943; 0.000839],
  cnr=[-0.0001746; -0.0001176; -8.401e-5; -7.175e-5; -7.893e-5; -0.0001073; -0.0001597; -0.0002383; -0.0004786; -0.000556; -0.0006261; -0.000756; -0.0008675; -0.0009471; -0.000916; -0.000837; -0.0005681; -0.0002673; -9.805e-5; -0.0001058],
  clr=[-0.002217; -0.001482; -0.0007698; -8.625e-5; 0.0005917; 0.001306; 0.002051; 0.002821; 0.004408; 0.004809; 0.005145; 0.005716; 0.006164; 0.006465; 0.006349; 0.006045; 0.004869; 0.003056; 0.001124; -0.001278],
  wetarea_b=1.921,
  xcg_b=1.22,
  zcg_b=0.11,
  basearea_b=0.033,
  cd0_b=0.003081,
  basedrag_b=0.0005038,
  fricdrag_b=0.002577,
  presdrag_b=NaN,
  lemac=0.3,
  area_w_tt=3.622,
  taperratio_w_tt=0.619,
  aspectratio_w_tt=9.94,
  qcsweep_w_tt=4.824,
  mac_w_tt=0.616,
  qcmac_w_tt=1.08,
  ymac_w_tt=1.38,
  cd0_w_tt=99999,
  friccoeff_w_tt=99999,
  area_w_te=3.15,
  taperratio_w_te=0.619,
  aspectratio_w_te=8.967,
  qcsweep_w_te=4.824,
  mac_w_te=0.606,
  qcmac_w_te=1.12,
  ymac_w_te=1.56,
  cd0_w_te=0.0136,
  friccoeff_w_te=0.00621,
  cla_b_w=0.01068,
  cla_w_b=0.07637,
  k_b_w=0.1527,
  k_w_b=1.091,
  xacc_b_w=0.3414,
  hiv_b_w=repmat(99999, 20, 1),
  hiv_w_h=repmat(99999, 20, 1),
  hiv_b_h=repmat(99999, 20, 1),
  gamma=[NaN; NaN; NaN; 0; 0; 0; 0; 0; NaN; NaN; NaN; NaN; NaN; NaN; NaN; NaN; NaN; NaN; NaN; NaN],
  gamma2pialpvr=repmat(NaN, 20, 1),
  iv_b_w=repmat(0, 20, 1),
  iv_w_h=repmat(NaN, 20, 1),
  iv_b_h=repmat(NaN, 20, 1),
  clpgammacl0=-0.48484,
  clpgammaclp=1,
  cnptheta=0.00042408,
  cypgamma=0,
  cypcl=-0.080076,
  clbgamma=-0.0002641,
  cmothetaw=NaN,
  cmothetah=NaN,
  clroll=[-0.077957; -0.064677; -0.043756; -0.021878; 0; 0.021878; 0.043756; 0.064677; 0.077957],
  cn_asy=[-0.005632 -0.004673 -0.003161 -0.001581 0 0.001581 0.003161 0.004673 0.005632
   -0.003765 -0.003124 -0.002113 -0.001057 0 0.001057 0.002113 0.003124 0.003765
   -0.001955 -0.001622 -0.001098 -0.0005488 0 0.0005488 0.001098 0.001622 0.001955
   -0.0002191 -0.0001818 -0.000123 -6.149e-5 0 6.149e-5 0.000123 0.0001818 0.0002191
   0.001503 0.001247 0.0008436 0.0004218 0 -0.0004218 -0.0008436 -0.001247 -0.001503
   0.003318 0.002752 0.001862 0.0009311 0 -0.0009311 -0.001862 -0.002752 -0.003318
   0.005211 0.004323 0.002925 0.001462 0 -0.001462 -0.002925 -0.004323 -0.005211
   0.007167 0.005946 0.004023 0.002011 0 -0.002011 -0.004023 -0.005946 -0.007167
   0.0112 0.00929 0.006285 0.003142 0 -0.003142 -0.006285 -0.00929 -0.0112
   0.01222 0.01014 0.006857 0.003428 0 -0.003428 -0.006857 -0.01014 -0.01222
   0.01307 0.01084 0.007336 0.003668 0 -0.003668 -0.007336 -0.01084 -0.01307
   0.01452 0.01205 0.00815 0.004075 0 -0.004075 -0.00815 -0.01205 -0.01452
   0.01566 0.01299 0.008789 0.004395 0 -0.004395 -0.008789 -0.01299 -0.01566
   0.01642 0.01363 0.009218 0.004609 0 -0.004609 -0.009218 -0.01363 -0.01642
   0.01613 0.01338 0.009053 0.004526 0 -0.004526 -0.009053 -0.01338 -0.01613
   0.01536 0.01274 0.008619 0.004309 0 -0.004309 -0.008619 -0.01274 -0.01536
   0.01237 0.01026 0.006942 0.003471 0 -0.003471 -0.006942 -0.01026 -0.01237
   0.007764 0.006441 0.004358 0.002179 0 -0.002179 -0.004358 -0.006441 -0.007764
   0.002855 0.002368 0.001602 0.0008011 0 -0.0008011 -0.001602 -0.002368 -0.002855
   -0.003247 -0.002694 -0.001822 -0.0009112 0 0.0009112 0.001822 0.002694 0.003247]), struct(
  case="TOTAL: AILERONS: UAV",
  mach=0.04,
  alt=100,
  alpha=[-10 -8 -6 -4 -2 0 2 4 8 9 10 12 14 16 18 19 20 21 22 24],
  nmach=1,
  nalt=1,
  nalpha=20,
  rnnub=[],
  hypers=false,
  loop=1,
  sref=3.588,
  cbar=0.6109,
  blref=5.91,
  dim="ft",
  deriv="deg",
  stmach=0.6,
  tsmach=1.4,
  save=false,
  stype=[],
  trim=false,
  damp=true,
  build=1,
  part=true,
  highsym=true,
  highasy=false,
  highcon=false,
  tjet=false,
  hypeff=false,
  lb=false,
  pwr=false,
  grnd=false,
  wsspn=2.6575,
  hsspn=0.66,
  ndelta=8,
  delta=[-15 -10 -5 0 5 10 13 16],
  deltal=[],
  deltar=[],
  ngh=0,
  grndht=[],
  config=struct(downwash=true, body=true, wing=true, htail=true, vtail=true, vfin=false),
  version=1976,
  cd=[0.051; 0.037; 0.029; 0.024; 0.024; 0.028; 0.036; 0.05; 0.093; 0.107; 0.121; 0.147; 0.17; 0.19; 0.193; 0.184; 0.144; 0.096; 0.067; 0.052],
  cl=[-0.653; -0.449; -0.25; -0.059; 0.132; 0.331; 0.537; 0.75; 1.188; 1.299; 1.393; 1.556; 1.687; 1.782; 1.767; 1.695; 1.393; 0.924; 0.418; -0.247],
  cm=[0.0687; 0.0743; 0.074; 0.0679; 0.0574; 0.0573; 0.0608; 0.0612; 0.0598; 0.0593; 0.0532; 0.0286; -0.0067; -0.0613; NaN; NaN; NaN; NaN; NaN; NaN],
  cn=[-0.652; -0.45; -0.252; -0.06; 0.132; 0.331; 0.538; 0.751; 1.19; 1.3; 1.393; 1.552; 1.678; 1.765; 1.74; 1.662; 1.358; 0.897; 0.412; -0.204],
  ca=[-0.064; -0.026; 0.002; 0.02; 0.028; 0.028; 0.018; -0.002; -0.073; -0.097; -0.123; -0.18; -0.243; -0.308; -0.362; -0.378; -0.342; -0.242; -0.095; 0.148],
  xcp=[-0.105; -0.165; -0.294; -1.129; 0.436; 0.173; 0.113; 0.081; 0.05; 0.046; 0.038; 0.018; -0.004; -0.035; NaN; NaN; NaN; NaN; NaN; NaN],
  cma=[0.003056; 0.001336; -0.0016; -0.004161; -0.002657; 0.0008498; 0.0009853; 2.578e-5; -0.0004981; -0.003293; -0.008134; -0.01498; -0.02249; -0.03213; NaN; NaN; NaN; NaN; NaN; NaN],
  cyb=repmat(-0.00246, 20, 1),
  cnb=repmat(0.09896, 20, 1),
  clb=[-0.0005913; -0.0006471; -0.0007001; -0.0007494; -0.0007975; -0.0008486; -0.0009026; -0.0009595; -0.001079; -0.00111; -0.001134; -0.00117; -0.00119; -0.001194; -0.001152; -0.001105; -0.0009692; -0.000765; -0.000543; -0.0002515],
  cla=[0.1043; 0.1006; 0.09761; 0.0957; 0.09736; 0.1011; 0.1047; 0.1076; 0.1106; 0.1024; 0.08977; 0.0735; 0.05645; 0.01999; -0.05064; -0.1869; -0.3856; -0.4879; -0.4481; -0.2161],
  qqinf=[1; 1; 1; 0.999; 0.948; 0.932; 0.988; 1; 1; 1; 1; 1; 1; 1; 1; 1; 1; 1; 1; 1],
  eps=[-2.278; -1.544; -0.813; -0.094; 0.636; 1.4; 2.162; 2.928; 4.452; 4.816; 5.163; 5.674; 6.09; 6.296; 6.225; 5.888; 5.294; 3.966; 2.631; 0.977],
  depsdalp=[0.367; 0.366; 0.363; 0.362; 0.373; 0.381; 0.382; 0.382; 0.367; 0.356; 0.316; 0.232; 0.156; 0.034; -0.237; -0.466; -0.961; -1.332; -1.166; -0.827],
  clq=repmat(0.09228, 20, 1),
  cmq=repmat(-0.3711, 20, 1),
  clad=[0.03181; 0.03173; 0.03141; 0.03137; 0.03067; 0.0308; 0.03271; 0.03313; 0.03183; 0.0308; 0.02742; 0.02007; 0.01348; 0.002941; -0.0205; -0.04034; -0.08327; -0.1154; -0.101; -0.07164],
  cmad=[-0.1342; -0.1339; -0.1326; -0.1324; -0.1295; -0.13; -0.138; -0.1398; -0.1343; -0.13; -0.1157; -0.08469; -0.05688; -0.01241; 0.08651; 0.1702; 0.3515; 0.487; 0.4263; 0.3023],
  clp=[-0.0001863; -0.0001621; -0.0001431; -0.0001302; -0.0001255; -0.0001284; -0.0001375; -0.0001524; -0.0002; -0.0002089; -0.0002127; -0.0002245; -0.000234; -0.0002248; -0.0001726; -5.986e-5; 0.0001379; 0.0002734; 0.0002643; 4.186e-5],
  cyp=[0.0003016; 0.0001603; 2.54e-5; -0.0001075; -0.0002486; -0.0004179; -0.0006276; -0.0009026; -0.001985; -0.002978; -0.04023; 0.000101; -0.0007384; -0.001287; -0.001638; -0.001875; -0.001556; -0.0007261; 0.0002154; 0.001363],
  cnp=[0.001069; 0.0007366; 0.0004126; 8.984e-5; -0.0002467; -0.0006263; -0.001067; -0.001605; -0.003469; -0.005004; -0.06013; -0.0006505; -0.002022; -0.002966; -0.003618; -0.004039; -0.003626; -0.002439; -0.001079; 0.0005317],
  cnr=[-0.0008617; -0.0008204; -0.0008008; -0.000801; -0.0008189; -0.0008563; -0.0009159; -0.0009999; -0.001245; -0.001323; -0.001393; -0.001521; -0.001628; -0.001702; -0.001663; -0.00158; -0.001306; -0.001; -0.0008252; -0.0008202],
  clr=[-0.001983; -0.00127; -0.0005801; 7.971e-5; 0.0007331; 0.001422; 0.002142; 0.002886; 0.004419; 0.004807; 0.005129; 0.005674; 0.006095; 0.00637; 0.006228; 0.005911; 0.004723; 0.002898; 0.0009534; -0.001472],
  wetarea_b=1.921,
  xcg_b=1.22,
  zcg_b=0.11,
  basearea_b=0.033,
  cd0_b=0.003081,
  basedrag_b=0.0005038,
  fricdrag_b=0.002577,
  presdrag_b=NaN,
  lemac=0.3,
  area_w_tt=3.622,
  taperratio_w_tt=0.619,
  aspectratio_w_tt=9.94,
  qcsweep_w_tt=4.824,
  mac_w_tt=0.616,
  qcmac_w_tt=1.08,
  ymac_w_tt=1.38,
  cd0_w_tt=99999,
  friccoeff_w_tt=99999,
  area_w_te=3.15,
  taperratio_w_te=0.619,
  aspectratio_w_te=8.967,
  qcsweep_w_te=4.824,
  mac_w_te=0.606,
  qcmac_w_te=1.12,
  ymac_w_te=1.56,
  cd0_w_te=0.0136,
  friccoeff_w_te=0.00621,
  area_ht_tt=0.5412,
  taperratio_ht_tt=0.608,
  aspectratio_ht_tt=3.22,
  qcsweep_ht_tt=11,
  mac_ht_tt=0.418,
  qcmac_ht_tt=3.8,
  ymac_ht_tt=0.303,
  cd0_ht_tt=99999,
  friccoeff_ht_tt=99999,
  area_ht_te=0.5412,
  taperratio_ht_te=0.608,
  aspectratio_ht_te=3.22,
  qcsweep_ht_te=11,
  mac_ht_te=0.418,
  qcmac_ht_te=3.8,
  ymac_ht_te=0.303,
  cd0_ht_te=0.0023,
  friccoeff_ht_te=0.00667,
  area_vt_tt=0.3312,
  taperratio_vt_tt=0.394,
  aspectratio_vt_tt=1.565,
  qcsweep_vt_tt=23,
  mac_vt_tt=0.489,
  qcmac_vt_tt=3.53,
  ymac_vt_tt=0.468,
  cd0_vt_tt=99999,
  friccoeff_vt_tt=99999,
  area_vt_te=0.3312,
  taperratio_vt_te=0.394,
  aspectratio_vt_te=1.565,
  qcsweep_vt_te=23,
  mac_vt_te=0.489,
  qcmac_vt_te=3.53,
  ymac_vt_te=0.308,
  cd0_vt_te=0.00136,
  friccoeff_vt_te=0.00647,
  cla_b_w=0.01068,
  cla_w_b=0.07637,
  k_b_w=0.1527,
  k_w_b=1.091,
  xacc_b_w=0.3414,
  cla_b_h=0,
  cla_h_b=0.01027,
  k_b_h=0,
  k_h_b=1,
  xacc_b_h=0.2075,
  sidewash=0.67157567,
  hiv_b_w=repmat(99999, 20, 1),
  hiv_w_h=repmat(99999, 20, 1),
  hiv_b_h=repmat(99999, 20, 1),
  gamma=[NaN; NaN; NaN; 0; 0; 0; 0; 0; NaN; NaN; NaN; NaN; NaN; NaN; NaN; NaN; NaN; NaN; NaN; NaN],
  gamma2pialpvr=[0.637; 0.4918; 0.406; 0; 0; 0; 0; 0; 0.4918; 0.5661; 0.637; 0.7929; 0.9332; 1.084; 1.23; 1.304; 1.383; 1.439; 1.497; 1.619],
  iv_b_w=repmat(0, 20, 1),
  iv_w_h=repmat(NaN, 20, 1),
  iv_b_h=[-0.1774; -0.08325; -0.003164; 0; 0; 0; 0; 0; -0.08325; -0.1385; -0.1774; -0.2285; -0.2498; -0.2595; -0.2676; -0.2689; -0.2696; -0.27; -0.2704; -0.2706],
  clpgammacl0=-0.48484,
  clpgammaclp=1,
  cnptheta=0.00042408,
  cypgamma=0,
  cypcl=-0.080076,
  clbgamma=-0.0002641,
  cmothetaw=NaN,
  cmothetah=NaN,
  dcl_sym=[-0.084; -0.057; -0.028; 0; 0.028; 0.057; 0.073; 0.088],
  dcm_sym=[0.2784; 0.1903; 0.0952; -0.0002; -0.0952; -0.1903; -0.2448; -0.2935],
  dclmax_sym=[0.056; 0.041; 0.021; 0; 0.021; 0.041; 0.05; 0.059],
  dcdmin_sym=[0.00218; 0.00088; 0.00044; 0; 0.00044; 0.00088; 0.00166; 0.00248],
  clad_sym=repmat(NaN, 8, 1),
  cha_sym=[-0.002215; 99999; 99999; 99999; 99999; 99999; 99999; 99999],
  chd_sym=[-0.00626; -0.006213; -0.006213; -0.006213; -0.006213; -0.006213; -0.006231; -0.006284],
  dcdi_sym=[0.00555 0.0032 0.00129 -1.95e-6 -0.000663 -0.000699 -0.000434 -2.41e-5
   0.00465 0.00258 0.000979 -1.33e-6 -0.000352 -7.85e-5 0.000365 0.000935
   0.00373 0.00196 0.000668 -7.08e-7 -4.13e-5 0.000544 0.00117 0.0019
   0.00281 0.00133 0.000354 -8.0e-8 0.000273 0.00117 0.00198 0.00287
   0.0019 0.000711 4.24e-5 5.43e-7 0.000584 0.00179 0.00278 0.00383
   0.00101 0.000105 -0.00026 1.15e-6 0.000887 0.0024 0.00356 0.00477
   0.000121 -0.000502 -0.000564 1.76e-6 0.00119 0.00301 0.00434 0.0057
   -0.000766 -0.00111 -0.000866 2.36e-6 0.00149 0.00361 0.00512 0.00664
   -0.00255 -0.00232 -0.00147 3.57e-6 0.0021 0.00483 0.00669 0.00851
   -0.003 -0.00263 -0.00163 3.89e-6 0.00226 0.00514 0.00709 0.009
   -0.00347 -0.00295 -0.00179 4.21e-6 0.00242 0.00546 0.0075 0.00949
   -0.00454 -0.00368 -0.00215 4.94e-6 0.00278 0.00619 0.00844 0.0106
   -0.00568 -0.00446 -0.00254 5.71e-6 0.00317 0.00696 0.00944 0.0118
   -0.00697 -0.00534 -0.00298 6.59e-6 0.00361 0.00784 0.0106 0.0132
   -0.00846 -0.00635 -0.00349 7.61e-6 0.00412 0.00886 0.0119 0.0147
   -0.00942 -0.00701 -0.00382 8.27e-6 0.00444 0.00951 0.0127 0.0158
   -0.0106 -0.00779 -0.00421 9.05e-6 0.00483 0.0103 0.0137 0.017
   -0.0122 -0.00893 -0.00478 1.02e-5 0.00541 0.0114 0.0152 0.0187
   -0.0139 -0.0101 -0.00535 1.13e-5 0.00598 0.0126 0.0167 0.0205
   -0.0165 -0.0119 -0.00625 1.31e-5 0.00687 0.0144 0.019 0.0233])}